# Grasshopper definition 2021_04_06-1st_tradition.gh (Grasshopper 1.0.7)

number_slider = Slider(5, range=0..10)
number_slider_2 = Slider(20, range=15..50)
number_slider_3 = Slider(2, range=0..10)
number_slider_4 = Slider(50, range=0..100)
number_slider_5 = Slider(2.5, range=0..10)
number_slider_6 = Slider(45, range=0..100)
division = Division(A=number_slider_6, B=number_slider_3)
neg = Negative(Value=division)
pt = ConstructPoint(XCoordinate=0, YCoordinate=0, ZCoordinate=0)
division_2 = Division(A=Slider(10.8, range=0..20), B=number_slider_3)
neg_2 = Negative(Value=number_slider_2)
dom = ConstructDomain(DomainStart=neg, DomainEnd=division)
neg_3 = Negative(Value=number_slider)
division_3 = Division(A=Slider(3, range=0..20), B=Slider(2, range=0..10))
multiplication = Multiplication(A=number_slider_4, B=Slider(0.8, range=0..1))
addition = Addition(A=division_2, B=Slider(1.5, range=0..10))
dom_2 = ConstructDomain(DomainStart=neg_2, DomainEnd=number_slider_2)
dom_3 = ConstructDomain(DomainStart=neg_3, DomainEnd=0)
X = UnitX(Factor=number_slider_6)
rectangle = Rectangle(Plane=PlaneXY(0, 0, 0), XSize=number_slider_6, YSize=dom, Radius=0)  # -> Rectangle, Length
neg_4 = Negative(Value=number_slider_4)
origin = Point(pt)
neg_5 = Negative(Value=number_slider_5)
neg_6 = Negative(Value=multiplication)
neg_7 = Negative(Value=addition)
addition_2 = Addition(A=origin, B=X)
rectangle_2 = Rectangle(Plane=PlaneXY(0, 0, 0), XSize=dom_3, YSize=dom_2, Radius=0)  # -> Rectangle, Length
pt_2 = ConstructPoint(XCoordinate=neg_5, YCoordinate=0, ZCoordinate=neg_4)
pt_3 = ConstructPoint(XCoordinate=number_slider_5, YCoordinate=0, ZCoordinate=neg_4)
X_2 = UnitX(Factor=neg_7)
crv = Curve(rectangle.Rectangle)
addition_3 = Addition(A=number_slider_6, B=number_slider)
cir = Circle(Plane=X_2, Radius=division_2)
cir_2 = Circle(Plane=X_2, Radius=addition)
merge = Merge(Data1=rectangle_2.Rectangle, Data2=cir_2)
dom_4 = ConstructDomain(DomainStart=neg_7, DomainEnd=addition_3)
dom_5 = ConstructDomain(DomainStart=neg_7, DomainEnd=addition)
dom_6 = ConstructDomain(DomainStart=number_slider_6, DomainEnd=addition_3)
runion = RegionUnion(Curves=merge)
rectangle_3 = Rectangle(Plane=PlaneXY(0, 0, 0), XSize=dom_4, YSize=dom_5, Radius=0)  # -> Rectangle, Length
rectangle_4 = Rectangle(Plane=PlaneXY(0, 0, 0), XSize=dom_6, YSize=dom_5, Radius=0)  # -> Rectangle, Length
extr = Extrude(Base=rectangle_4.Rectangle, Direction=pt_2)
extr_2 = Extrude(Base=cir, Direction=pt_3)
extr_3 = Extrude(Base=runion, Direction=pt_3)
cap = CapHoles(Brep=extr)
cap_2 = CapHoles(Brep=extr_3)
cap_3 = CapHoles(Brep=extr_2)
merge_2 = Merge(Data1=rectangle_3.Rectangle, Data2=cir_2, Data3=rectangle_2.Rectangle)
runion_2 = RegionUnion(Curves=merge_2)
Z = UnitZ(Factor=Slider(7, range=0..10))
bbox = BoundingBox(Content=runion_2, Plane=PlaneXY(0, 0, 0))  # -> Box, Box_2
extr_4 = Extrude(Base=runion_2, Direction=Z)
debox = DeconstructBox(Box=bbox.Box)  # -> Plane, X, Y, Z
cap_4 = CapHoles(Brep=extr_4)
num = Number(0)
dedomain = DeconstructDomain(Domain=debox.X)  # -> Start, End
dedomain_2 = DeconstructDomain(Domain=debox.Y)  # -> Start, End
addition_4 = Addition(A=dedomain_2.End, B=division_2)
pt_4 = ConstructPoint(XCoordinate=dedomain.Start, YCoordinate=num, ZCoordinate=neg_6)
division_4 = Division(A=addition_4, B=2)
neg_8 = Negative(Value=division_4)
pt_5 = ConstructPoint(XCoordinate=dedomain.Start, YCoordinate=neg_8, ZCoordinate=neg_6)
pt_6 = ConstructPoint(XCoordinate=dedomain.Start, YCoordinate=division_4, ZCoordinate=neg_6)
pt_7 = ConstructPoint(XCoordinate=dedomain.End, YCoordinate=neg_8, ZCoordinate=neg_6)
pt_8 = ConstructPoint(XCoordinate=dedomain.End, YCoordinate=division_4, ZCoordinate=neg_6)
pt_9 = ConstructPoint(XCoordinate=dedomain.End, YCoordinate=num, ZCoordinate=neg_6)
ln = Line(StartPoint=pt_9, EndPoint=pt_4)
ln_2 = Line(StartPoint=pt_8, EndPoint=pt_6)
ln_3 = Line(StartPoint=pt_7, EndPoint=pt_5)
merge_3 = Merge(Data1=ln_2, Data2=ln_3)
pipe = Pipe(Curve=merge_3, Radius=division_3, Caps=1)
sdiff = SolidDifference(BrepsA=cap_2, BrepsB=flatten(pipe))
pipe_2 = Pipe(Curve=ln, Radius=division_3, Caps=1)
sdiff_2 = SolidDifference(BrepsA=cap, BrepsB=flatten(pipe_2))
merge_4 = Merge(Data1=sdiff, Data2=sdiff_2, Data3=cap_4)  # -> flatten(Result)
sunion = SolidUnion(Breps=merge_4)
sdiff_3 = SolidDifference(BrepsA=sunion, BrepsB=cap_3)
